# Grasshopper definition SCI8_Simulation.gh (Grasshopper 1.0.8)
# plug-ins: TT Toolbox

genes = GenePool(
    Decimals=0,
    Maximum=100,
    Minimum=16,
    Value=[16, 16, 16, 16, 16, 16, 16, 16, 16, 16, 16, 16, 16, 16, 16, 16, 16, 16, 16, 16, 16, 16, 16, 16])

# ---- group: Schedule / 人员在室率
genes_2 = GenePool(Decimals=0, Maximum=1, Minimum=0, Value=[0, 0, 0, 0, 0, 0, 0, 1, 1, 1, 1, 1, 1, 1, 1, 1, 1, 1, 1, 0, 0, 0, 0, 0])
weeklyschedule = HBWeeklySchedule(sun=genes_2, mon=genes_2, tue=genes_2, wed=genes_2, thu=genes_2, fri=genes_2, sat=genes_2)  # -> report, schedule, idf_year, idf_week, idf_days; plug-in component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

# ---- group: Schedule / 采暖时间表
genes_3 = GenePool(
    Decimals=0,
    Maximum=100,
    Minimum=16,
    Value=[16, 16, 16, 16, 16, 16, 18, 22, 22, 22, 22, 22, 22, 22, 22, 22, 22, 22, 22, 22, 22, 22, 16, 16])
panel = Panel("Temperature")
weeklyschedule_2 = HBWeeklySchedule(sun=genes, mon=genes_3, tue=genes_3, wed=genes_3, thu=genes_3, fri=genes_3, sat=genes, name="Heat", type_limit=panel)  # -> report, schedule, idf_year, idf_week, idf_days; plug-in component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

# ----
genes_4 = GenePool(
    Decimals=0,
    Maximum=100,
    Minimum=0,
    Value=[29, 29, 29, 29, 29, 29, 29, 29, 29, 29, 29, 29, 29, 29, 29, 29, 29, 29, 29, 29, 29, 29, 29, 29])

# ---- group: Schedule / 制冷时间表
genes_5 = GenePool(
    Decimals=0,
    Maximum=100,
    Minimum=0,
    Value=[29, 29, 29, 29, 29, 29, 29, 27, 26, 26, 26, 26, 26, 26, 26, 26, 26, 26, 26, 26, 26, 26, 29, 29])
panel_2 = Panel("Temperature")
weeklyschedule_3 = HBWeeklySchedule(
    sun=genes_4,
    mon=genes_5,
    tue=genes_5,
    wed=genes_5,
    thu=genes_5,
    fri=genes_5,
    sat=genes_4,
    name="cool",
    type_limit=panel_2)  # -> report, schedule, idf_year, idf_week, idf_days; plug-in component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

# ---- group: Schedule
number_slider = Slider(31, range=0..100)
number_slider_2 = Slider(6.5, range=0..10)
number_slider_3 = Slider(3, range=0..10)

# ---- group: Schedule / 通风
genes_6 = GenePool(Decimals=0, Maximum=1, Minimum=0, Value=[0, 0, 0, 0, 0, 0, 0, 1, 1, 1, 1, 1, 1, 1, 1, 1, 1, 1, 1, 1, 1, 1, 0, 0])
weeklyschedule_4 = HBWeeklySchedule(sun=genes_6, mon=genes_6, tue=genes_6, wed=genes_6, thu=genes_6, fri=genes_6, sat=genes_6)  # -> report, schedule, idf_year, idf_week, idf_days; plug-in component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

# ----
number_slider_4 = Slider(26, range=0..100)

# ---- group: Schedule
constantschedule = HBConstantSchedule(values=Slider(29, range=0..100), type_limit=panel_2)  # -> report, schedule, idf_text; plug-in component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
analysisperiod = LBAnalysisPeriod(
    start_month=Slider(5, range=0..10),
    start_day=Slider(1, range=0..1),
    start_hour=0,
    end_month=Slider(7, range=0..10),
    end_day=number_slider)  # -> period, hoys, dates; plug-in component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
seasonalschedule = HBSeasonalSchedule(
    base_schedule=constantschedule.schedule,
    season_scheds=weeklyschedule_3.schedule,
    analysis_periods=analysisperiod.period,
    summer_des=number_slider_4)  # -> out, schedule, idf_year, idf_week, idf_days; plug-in component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

# ----
analysisperiod_2 = LBAnalysisPeriod(
    start_month=Slider(9, range=0..10),
    start_day=Slider(1, range=0..100),
    start_hour=0,
    end_month=Slider(10, range=0..10),
    end_day=Slider(30, range=0..100))  # -> period, hoys, dates; plug-in component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
analysisperiod_3 = LBAnalysisPeriod(
    start_month=Slider(2, range=-11..50),
    start_day=Slider(20, range=0..100),
    start_hour=0,
    end_month=Slider(4, range=0..10),
    end_day=Slider(1, range=0..100))  # -> period, hoys, dates; plug-in component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
number_slider_5 = Slider(22, range=0..100)

# ---- group: Schedule
constantschedule_2 = HBConstantSchedule(values=Slider(16, range=0..100), type_limit=panel)  # -> report, schedule, idf_text; plug-in component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
analysisperiod_4 = LBAnalysisPeriod(
    start_month=Slider(1, range=-11..50),
    start_day=Slider(1, range=0..1),
    start_hour=0,
    end_month=Slider(1, range=0..10),
    end_day=Slider(19, range=0..100))  # -> period, hoys, dates; plug-in component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
analysisperiod_5 = LBAnalysisPeriod(
    start_month=Slider(11, range=-11..50),
    start_day=Slider(15, range=0..100),
    start_hour=0,
    end_month=Slider(12, range=0..12),
    end_day=Slider(31, range=0..100))  # -> period, hoys, dates; plug-in component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
seasonalschedule_2 = HBSeasonalSchedule(
    base_schedule=constantschedule_2.schedule,
    season_scheds=weeklyschedule_2.schedule,
    analysis_periods=analysisperiod_4.period,
    winter_des=number_slider_5)  # -> out, schedule, idf_year, idf_week, idf_days; plug-in component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
seasonalschedule_3 = HBSeasonalSchedule(
    base_schedule=constantschedule_2.schedule,
    season_scheds=weeklyschedule_2.schedule,
    analysis_periods=analysisperiod_5.period,
    winter_des=number_slider_5)  # -> out, schedule, idf_year, idf_week, idf_days; plug-in component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

# ----
seasonalschedule_4 = HBSeasonalSchedule(
    base_schedule=constantschedule.schedule,
    season_scheds=weeklyschedule_3.schedule,
    analysis_periods=analysisperiod_2.period,
    summer_des=number_slider_4)  # -> out, schedule, idf_year, idf_week, idf_days; plug-in component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
seasonalschedule_5 = HBSeasonalSchedule(
    base_schedule=constantschedule_2.schedule,
    season_scheds=weeklyschedule_2.schedule,
    analysis_periods=analysisperiod_3.period,
    winter_des=number_slider_5)  # -> out, schedule, idf_year, idf_week, idf_days; plug-in component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

# ---- group: Schedule / 人员在室率
genes_7 = GenePool(Decimals=0, Maximum=1, Minimum=0, Value=[0, 0, 0, 0, 0, 0, 0, 1, 1, 1, 1, 1, 0, 0, 0, 0, 1, 1, 1, 1, 1, 1, 1, 0])
weeklyschedule_5 = HBWeeklySchedule(sun=genes_7, mon=genes_7, tue=genes_7, wed=genes_7, thu=genes_7, fri=genes_7, sat=genes_7)  # -> report, schedule, idf_year, idf_week, idf_days; plug-in component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

# ---- group: Schedule
setpoint = HBSetpoint(
    heating_sch=[seasonalschedule_2.schedule, seasonalschedule_3.schedule, seasonalschedule_5.schedule],
    cooling_sch=[seasonalschedule.schedule, seasonalschedule_4.schedule])  # -> setpoint; plug-in component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
people = HBPeople(ppl_per_area=Slider(0.04, range=0..0.1), occupancy_sch=weeklyschedule.schedule)  # -> people; plug-in component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
lighting = HBLighting(watts_per_area=number_slider_3, schedule=weeklyschedule_5.schedule)  # -> lighting; plug-in component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
ventilation = HBVentilation(flow_per_person=Slider(0.00833, range=0..0.01), ach=Slider(0.5, range=0..1), schedule=weeklyschedule_4.schedule)  # -> vent; plug-in component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
programtype = HBProgramType(name="school", people=people, lighting=lighting, ventilation=ventilation, setpoint=setpoint)  # -> program; plug-in component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

# ----
number_slider_6 = Slider(0.5, range=0..1)
facparam = HBFacadeParameters(north=number_slider_6, east=number_slider_6, south=number_slider_6, west=number_slider_6)  # -> fac_par; plug-in component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
simpleratiopar = DFSimpleWindowRatioParameters(ratio=facparam)  # -> win_par; plug-in component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
swatch = ColourSwatch(SwatchColor=RGB(255, 255, 255))
panel_3 = Panel("C:\Users\DELL\Desktop\SCI8\Simulation\gh_building_simulation_min_inputs.xlsx")
number_slider_7 = Slider(3114, range=3114..3357)
ladybug = Ladybug_Ladybug()  # -> Vviiiiiiiiiizzz; plug-in component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
toggle = BooleanToggle(True)
fly = Ladybug_fly(inputSliders=number_slider_7, fly=Toggle(False))  # -> Vviiiiiiiiiizzz; plug-in component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
readxl = ReadExcelSheet(Run=Toggle(True), FilePath=panel_3, Worksheet="1", Listen=False)  # -> UserMessages, Columns, Rows
simoutput = HBSimulationOutput(zone_energy_use=toggle, system_energy_use=toggle, report_frequency="Hourly")  # -> report, sim_output; plug-in component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
number_slider_8 = Slider(1, range=0..1)

# ---- group: 楼编号
item = ListItem(List=readxl.Rows, Index=Slider(0, range=0..100), Wrap=True)  # -> flatten(Item)
item_2 = ListItem(List=item, Index=number_slider_7, Wrap=True)
panel_4 = Panel(item_2)

# ----
panel_5 = Panel("C:\Users\DELL\Desktop\SCI8\shandong_teaching_campus_overview_package")
panel_6 = Panel("SD0010")
py3 = Python3Script(
    y=panel_5,
    x=panel_4,
    floor_count=Slider(4, range=0..10),
    angle_tol_deg=Slider(8, range=0..10),
    south_angle_deg=Slider(60, range=0..100))  # -> RawMesh, CleanMass, Footprint, StoryBreps, Roof, SouthWalls, Log
# ---------- py3: Python ----------
# -*- coding: utf-8 -*-
import os
import math
import Rhino.Geometry as rg

DEFAULT_BASE_DIR = r"C:\Users\DELL\Desktop\SCI8\shandong_teaching_campus_overview_package"

def clean_text(v):
    if v is None:
        return ""
    return str(v).strip().strip('"').strip("'")

def get_input(name, default_value):
    try:
        if name in globals():
            v = globals()[name]
            if v is not None:
                return v
    except:
        pass
    return default_value

def parse_input_id(input_id):
    input_id = clean_text(input_id)
    if input_id == "":
        input_id = "SD0010"

    if "_T" in input_id:
        sample_uid = input_id.split("_T")[0]
        target_object_name = input_id
    else:
        sample_uid = input_id
        target_object_name = ""

    return sample_uid, target_object_name

def is_target_object(obj_name, target_name):
    if target_name == "":
        return True
    if obj_name == target_name:
        return True
    if obj_name.startswith(target_name + "_"):
        return True
    return False

def edge_key(a, b):
    if a < b:
        return (a, b)
    return (b, a)

def face_indices(face):
    if face.IsTriangle:
        return [face.A, face.B, face.C]
    return [face.A, face.B, face.C, face.D]

def loop_area_xy(points):
    area = 0.0
    n = len(points)
    for i in range(n):
        p = points[i]
        q = points[(i + 1) % n]
        area += p.X * q.Y - q.X * p.Y
    return area * 0.5

def add_face(mesh, ids):
    if len(ids) < 3:
        return 0
    if len(set(ids)) < 3:
        return 0

    if len(ids) == 3:
        mesh.Faces.AddFace(ids[0], ids[1], ids[2])
        return 1

    if len(ids) == 4:
        if len(set(ids)) == 4:
            mesh.Faces.AddFace(ids[0], ids[1], ids[2], ids[3])
            return 1
        return 0

    count = 0
    root = ids[0]
    for i in range(1, len(ids) - 1):
        tri = [root, ids[i], ids[i + 1]]
        if len(set(tri)) == 3:
            mesh.Faces.AddFace(tri[0], tri[1], tri[2])
            count += 1
    return count

def read_obj_grouped(obj_path):
    vertices = []
    object_faces = {}
    object_order = []
    current_object = ""

    with open(obj_path, "rb") as f:
        for raw_bytes in f:
            line = raw_bytes.decode("utf-8", "ignore").strip()

            if line == "":
                continue

            if line.startswith("o "):
                current_object = line[2:].strip()
                if current_object not in object_faces:
                    object_faces[current_object] = []
                    object_order.append(current_object)

            elif line.startswith("v "):
                p = line.split()
                if len(p) >= 4:
                    vertices.append(rg.Point3d(float(p[1]), float(p[2]), float(p[3])))

            elif line.startswith("f "):
                if "_T" not in current_object:
                    continue

                ids = []
                for token in line.split()[1:]:
                    idx_text = token.split("/")[0]
                    if idx_text == "":
                        continue

                    idx = int(idx_text)
                    if idx < 0:
                        idx = len(vertices) + idx
                    else:
                        idx = idx - 1

                    ids.append(idx)

                if len(ids) >= 3:
                    if current_object not in object_faces:
                        object_faces[current_object] = []
                        object_order.append(current_object)
                    object_faces[current_object].append(ids)

    teaching_names = []
    for name in object_order:
        if "_T" in name and len(object_faces.get(name, [])) > 0:
            teaching_names.append(name)

    return vertices, object_faces, teaching_names

def build_mesh(vertices, object_faces, names):
    mesh = rg.Mesh()
    vertex_map = {}

    def local_id(global_id):
        if global_id not in vertex_map:
            p = vertices[global_id]
            vertex_map[global_id] = mesh.Vertices.Add(p)
        return vertex_map[global_id]

    for name in names:
        faces = object_faces.get(name, [])
        for ids in faces:
            local_ids = []
            for gid in ids:
                if 0 <= gid < len(vertices):
                    local_ids.append(local_id(gid))
            add_face(mesh, local_ids)

    mesh.FaceNormals.ComputeFaceNormals()
    mesh.Normals.ComputeNormals()
    mesh.UnifyNormals()
    mesh.Weld(math.pi)
    mesh.Compact()

    return mesh

def build_boundary_loop(mesh, min_z, z_tol):
    bottom_faces = []

    for i in range(mesh.Faces.Count):
        f = mesh.Faces[i]
        ids = face_indices(f)
        zs = [mesh.Vertices[j].Z for j in ids]

        if max(zs) <= min_z + z_tol:
            bottom_faces.append(ids)

    edge_counts = {}

    for ids in bottom_faces:
        n = len(ids)
        for i in range(n):
            k = edge_key(ids[i], ids[(i + 1) % n])
            edge_counts[k] = edge_counts.get(k, 0) + 1

    boundary_edges = [k for k, c in edge_counts.items() if c == 1]

    adj = {}
    for a, b in boundary_edges:
        adj.setdefault(a, []).append(b)
        adj.setdefault(b, []).append(a)

    loops = []
    unused = set(boundary_edges)

    while len(unused) > 0:
        e = unused.pop()
        start = e[0]
        prev = e[0]
        cur = e[1]
        loop = [start, cur]

        while True:
            candidates = []
            for n in adj.get(cur, []):
                k = edge_key(cur, n)
                if k in unused and n != prev:
                    candidates.append(n)

            if len(candidates) == 0:
                break

            nxt = candidates[0]
            unused.remove(edge_key(cur, nxt))

            if nxt == start:
                break

            loop.append(nxt)
            prev = cur
            cur = nxt

        if len(loop) >= 3:
            loops.append(loop)

    best_pts = []
    best_area = 0.0

    for loop in loops:
        pts = []
        for idx in loop:
            p = mesh.Vertices[idx]
            pts.append(rg.Point3d(p.X, p.Y, min_z))

        area = abs(loop_area_xy(pts))
        if area > best_area:
            best_area = area
            best_pts = pts

    return best_pts

def remove_short_edges(points, tol):
    if len(points) < 3:
        return points

    out = []
    for p in points:
        if len(out) == 0:
            out.append(p)
        else:
            if out[-1].DistanceTo(p) > tol:
                out.append(p)

    if len(out) > 2 and out[0].DistanceTo(out[-1]) <= tol:
        out.pop()

    return out

def simplify_collinear(points, tol, angle_tol_deg):
    if len(points) <= 3:
        return points

    angle_tol = math.radians(angle_tol_deg)
    changed = True

    while changed and len(points) > 3:
        changed = False
        new_pts = []
        n = len(points)

        for i in range(n):
            a = points[(i - 1) % n]
            b = points[i]
            c = points[(i + 1) % n]

            v1 = rg.Vector3d(b.X - a.X, b.Y - a.Y, 0)
            v2 = rg.Vector3d(c.X - b.X, c.Y - b.Y, 0)

            if v1.Length <= tol or v2.Length <= tol:
                changed = True
                continue

            v1.Unitize()
            v2.Unitize()

            angle = rg.Vector3d.VectorAngle(v1, v2)

            if angle < angle_tol or abs(math.pi - angle) < angle_tol:
                changed = True
                continue

            new_pts.append(b)

        points = new_pts

    return points

def brep_face_normal_z(brep):
    if brep is None or brep.Faces.Count == 0:
        return 0.0

    face = brep.Faces[0]
    u_domain = face.Domain(0)
    v_domain = face.Domain(1)

    u = (u_domain.T0 + u_domain.T1) * 0.5
    v = (v_domain.T0 + v_domain.T1) * 0.5

    n = face.NormalAt(u, v)

    try:
        n.Unitize()
    except:
        pass

    return n.Z

def make_roof(points, z, tol):
    if points is None or len(points) < 3:
        return None

    pts = list(points)

    # From +Z view, counter-clockwise boundary should produce an upward roof normal.
    if loop_area_xy(pts) < 0:
        pts.reverse()

    roof_pts = []
    for p in pts:
        roof_pts.append(rg.Point3d(p.X, p.Y, z))

    roof_pts.append(roof_pts[0])

    crv = rg.PolylineCurve(roof_pts)
    breps = rg.Brep.CreatePlanarBreps(crv, tol)

    if breps and len(breps) > 0:
        roof = breps[0]

        # Fallback check: force roof normal to +Z.
        try:
            if brep_face_normal_z(roof) < 0:
                roof.Flip()
        except:
            pass

        return roof

    return None

def make_south_walls(points, min_z, max_z, south_angle_deg, tol):
    walls = []

    area = loop_area_xy(points)
    ccw = area > 0
    south = rg.Vector3d(0, -1, 0)
    limit = math.cos(math.radians(south_angle_deg))

    n = len(points)

    for i in range(n):
        p0 = points[i]
        p1 = points[(i + 1) % n]

        edge = rg.Vector3d(p1.X - p0.X, p1.Y - p0.Y, 0)
        if edge.Length <= tol:
            continue

        if ccw:
            outward = rg.Vector3d(edge.Y, -edge.X, 0)
        else:
            outward = rg.Vector3d(-edge.Y, edge.X, 0)

        outward.Unitize()

        if outward * south >= limit:
            b0 = rg.Point3d(p0.X, p0.Y, min_z)
            b1 = rg.Point3d(p1.X, p1.Y, min_z)
            t1 = rg.Point3d(p1.X, p1.Y, max_z)
            t0 = rg.Point3d(p0.X, p0.Y, max_z)

            wall = rg.Brep.CreateFromCornerPoints(b0, b1, t1, t0, tol)
            if wall:
                walls.append(wall)

    return walls

def extrude_curve_up(profile_curve, height, base_z, tol):
    ex = rg.Extrusion.Create(profile_curve, abs(height), True)
    if not ex:
        return None

    brep = ex.ToBrep()
    bbox = brep.GetBoundingBox(True)

    dz = base_z - bbox.Min.Z

    if abs(dz) > tol:
        brep.Transform(rg.Transform.Translation(0, 0, dz))

    return brep

def simplify_mesh_to_mass(mesh, floor_count, tol, angle_tol_deg, south_angle_deg):
    result = {
        "mass": None,
        "footprint": None,
        "stories": [],
        "roof": None,
        "south_walls": [],
        "height": 0.0,
        "point_count_before": 0,
        "point_count_after": 0
    }

    if mesh is None or mesh.Faces.Count == 0:
        return result

    bbox = mesh.GetBoundingBox(True)
    min_z = bbox.Min.Z
    max_z = bbox.Max.Z
    height = max_z - min_z
    result["height"] = height

    pts = build_boundary_loop(mesh, min_z, max(tol, 0.1))
    result["point_count_before"] = len(pts)

    pts = remove_short_edges(pts, tol)
    pts = simplify_collinear(pts, tol, angle_tol_deg)
    pts = remove_short_edges(pts, tol)

    result["point_count_after"] = len(pts)

    if len(pts) < 3:
        return result

    closed_pts = list(pts)
    closed_pts.append(pts[0])

    footprint = rg.PolylineCurve(closed_pts)
    result["footprint"] = footprint

    result["mass"] = extrude_curve_up(footprint, height, min_z, tol)

    floor_count = int(max(floor_count, 1))
    story_h = height / float(floor_count)

    for i in range(floor_count):
        crv = footprint.DuplicateCurve()
        story_base_z = min_z + story_h * i
        crv.Transform(rg.Transform.Translation(0, 0, story_h * i))

        story_brep = extrude_curve_up(crv, story_h, story_base_z, tol)
        if story_brep:
            result["stories"].append(story_brep)

    result["roof"] = make_roof(pts, max_z, tol)
    result["south_walls"] = make_south_walls(pts, min_z, max_z, south_angle_deg, tol)

    return result

# -------------------------
# Inputs
# -------------------------

input_id = clean_text(get_input("x", "SD0010"))
base_dir = clean_text(get_input("y", DEFAULT_BASE_DIR))

if base_dir == "":
    base_dir = DEFAULT_BASE_DIR

sample_uid, target_object_name = parse_input_id(input_id)

floor_count = int(get_input("floor_count", 4))
tol = float(get_input("tol", 0.5))
angle_tol_deg = float(get_input("angle_tol_deg", 8))
south_angle_deg = float(get_input("south_angle_deg", 60))

obj_path = os.path.join(base_dir, "models", "per_campus_obj", sample_uid + ".obj")

# -------------------------
# Outputs
# -------------------------

RawMesh = None
CleanMass = None
Footprint = None
StoryBreps = []
Roof = None
SouthWalls = []
ContextMasses = []
BuildingId = ""
Log = ""

# -------------------------
# Main
# -------------------------

if not os.path.exists(obj_path):
    Log = (
        "OBJ not found.\n"
        "Input id: " + input_id +
        "\nResolved campus id: " + sample_uid +
        "\nOBJ path:\n" + obj_path
    )

else:
    vertices, object_faces, teaching_names = read_obj_grouped(obj_path)

    target_names = []
    context_names = []

    for name in teaching_names:
        if is_target_object(name, target_object_name):
            target_names.append(name)
        else:
            context_names.append(name)

    if target_object_name == "":
        context_names = []

    if len(target_names) == 0:
        Log = (
            "No target teaching building found in OBJ.\n"
            "Input id: " + input_id +
            "\nResolved campus id: " + sample_uid +
            "\nTarget object name: " + target_object_name +
            "\nOBJ path:\n" + obj_path +
            "\n\nAvailable teaching objects:\n" + "\n".join(teaching_names)
        )

    else:
        RawMesh = build_mesh(vertices, object_faces, target_names)

        masses = []
        footprints = []
        roofs = []
        all_south_walls = []
        all_stories = []
        detail_logs = []

        for name in target_names:
            m = build_mesh(vertices, object_faces, [name])
            r = simplify_mesh_to_mass(m, floor_count, tol, angle_tol_deg, south_angle_deg)

            if r["mass"] is not None:
                masses.append(r["mass"])
            if r["footprint"] is not None:
                footprints.append(r["footprint"])
            if r["roof"] is not None:
                roofs.append(r["roof"])

            all_stories.extend(r["stories"])
            all_south_walls.extend(r["south_walls"])

            detail_logs.append(
                name +
                " | height=" + str(round(r["height"], 3)) +
                " | footprint_pts=" + str(r["point_count_before"]) +
                "->" + str(r["point_count_after"]) +
                " | south_walls=" + str(len(r["south_walls"]))
            )

        for name in context_names:
            cm = build_mesh(vertices, object_faces, [name])
            cr = simplify_mesh_to_mass(cm, floor_count, tol, angle_tol_deg, south_angle_deg)
            if cr["mass"] is not None:
                ContextMasses.append(cr["mass"])

        if len(masses) == 1:
            CleanMass = masses[0]
        else:
            CleanMass = masses

        if len(footprints) == 1:
            Footprint = footprints[0]
        else:
            Footprint = footprints

        if len(roofs) == 1:
            Roof = roofs[0]
        else:
            Roof = roofs

        StoryBreps = all_stories
        SouthWalls = all_south_walls

        if len(target_names) == 1:
            BuildingId = target_names[0]
        else:
            BuildingId = target_names

        Log = (
            "Import and simplification succeeded.\n"
            "Input id: " + input_id +
            "\nResolved campus id: " + sample_uid +
            "\nTarget object name: " + target_object_name +
            "\nOBJ path:\n" + obj_path +
            "\n\nTarget buildings: " + str(len(target_names)) +
            "\nContext buildings: " + str(len(context_names)) +
            "\nContext masses output: " + str(len(ContextMasses)) +
            "\nRawMesh vertices: " + str(RawMesh.Vertices.Count) +
            "\nRawMesh faces: " + str(RawMesh.Faces.Count) +
            "\nStoryBreps: " + str(len(StoryBreps)) +
            "\nSouthWalls: " + str(len(SouthWalls)) +
            "\n\nTarget detail:\n" + "\n".join(detail_logs)
        )
# ---------- end py3 ----------
item_3 = ListItem(List=readxl.Rows, Index=Slider(2, range=0..100), Wrap=True)  # -> flatten(Item)
item_4 = ListItem(List=item_3, Index=number_slider_7, Wrap=True)
preview = CustomPreview(Geometry=py3.RawMesh, Material=ColourSwatch(SwatchColor=RGB(242, 128, 128)))
建成年代 = Panel(item_4)
panel_7 = Panel(py3.StoryBreps)
geo = Geometry(py3.CleanMass)
geo_2 = Geometry(py3.SouthWalls)
area = Area(Geometry=geo_2)  # -> Area, Centroid

panel_8 = Panel(item_4)

# ---- group: 建筑层高
item_5 = ListItem(List=readxl.Rows, Index=Slider(1, range=0..1), Wrap=True)  # -> flatten(Item)
item_6 = ListItem(List=item_5, Index=number_slider_7, Wrap=True)
panel_9 = Panel(item_6)

# ---- group: 建筑体块
geo_3 = Geometry(geo)

# ----
debrep = DeconstructBrep(Brep=geo_3)  # -> Faces, Edges, Vertices
item_7 = ListItem(List=debrep.Faces, Index=0, Wrap=True)
area_2 = Area(Geometry=debrep.Faces)  # -> Area, Centroid
area_3 = Area(Geometry=item_7)  # -> Area, Centroid
ma = MassAddition(Input=area_2.Area)  # -> Result, PartialResults
panel_10 = Panel(ma.Result)
panel_11 = Panel(area_3.Area)
subtraction = Subtraction(A=ma.Result, B=area_3.Area)
volume = Volume(Geometry=geo_3)  # -> Volume, Centroid
建筑体积 = Panel(volume.Volume)
建筑总表面积 = Panel(subtraction)
division = Division(A=建筑总表面积, B=建筑体积)

建筑层高 = Panel(panel_9)
concat = Concatenate(FragmentA="C:\Users\DELL\Desktop\SCI8\Time series data\", FragmentB=panel_4, FragmentC=".xlsx")
py3_2 = Python3Script(building_id=panel_4, city="Jinan", year=建成年代)  # -> BuildingId, City, flatten(HourIndex), flatten(DateTime), flatten(Month), flatten(DayOfYear), flatten(HourOfDay), SinHour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
# ---------- py3_2: Python ----------
# -*- coding: utf-8 -*-
import math
import datetime

def clean_text(v):
    if v is None:
        return ""
    return str(v).strip().strip('"').strip("'")

def get_input(name, default_value):
    try:
        if name in globals():
            v = globals()[name]
            if v is not None:
                return v
    except:
        pass
    return default_value

# -------------------------
# Inputs
# -------------------------

input_building_id = clean_text(get_input("building_id", "SD0001_T001_1hao"))
input_city = clean_text(get_input("city", "济南市"))

try:
    input_year = int(get_input("year", 2025))
except:
    input_year = 2025

# -------------------------
# Outputs
# -------------------------

BuildingId = []
City = []
HourIndex = []
DateTime = []
Month = []
DayOfYear = []
HourOfDay = []
SinHour = []
CosHour = []
SinDay = []
CosDay = []
Log = ""

# -------------------------
# Main
# -------------------------

start_time = datetime.datetime(input_year, 1, 1, 0, 0, 0)

for i in range(8760):
    dt = start_time + datetime.timedelta(hours=i)

    hour_index = i + 1
    month = dt.month
    day_of_year = dt.timetuple().tm_yday
    hour_of_day = dt.hour

    # 小时周期：0点和23点在模型里应接近
    sin_hour = math.sin(2.0 * math.pi * hour_of_day / 24.0)
    cos_hour = math.cos(2.0 * math.pi * hour_of_day / 24.0)

    # 年周期：1月1日和12月31日在模型里应接近
    sin_day = math.sin(2.0 * math.pi * (day_of_year - 1) / 365.0)
    cos_day = math.cos(2.0 * math.pi * (day_of_year - 1) / 365.0)

    BuildingId.append(input_building_id)
    City.append(input_city)
    HourIndex.append(hour_index)
    DateTime.append(dt.strftime("%Y-%m-%d %H:%M:%S"))
    Month.append(month)
    DayOfYear.append(day_of_year)
    HourOfDay.append(hour_of_day)
    SinHour.append(sin_hour)
    CosHour.append(cos_hour)
    SinDay.append(sin_day)
    CosDay.append(cos_day)

Log = (
    "Time-series variables generated.\n"
    "building_id: " + input_building_id +
    "\ncity: " + input_city +
    "\nyear: " + str(input_year) +
    "\nrows: " + str(len(HourIndex))
)
# ---------- end py3_2 ----------
panel_12 = Panel(concat)
建筑层数 = Slider(4, range=3..8)

day_of_year = Panel(py3_2.DayOfYear)
datetime = Panel(py3_2.DateTime)
hour_of_day = Panel(py3_2.HourOfDay)
hourindex = Panel(py3_2.HourIndex)

# ---- group: 除教学楼外的建筑体块
geo_4 = Geometry(<extrusion referenced from the Rhino model>)

# ----
debrep_2 = DeconstructBrep(Brep=geo_4)  # -> Faces, Edges, Vertices
item_8 = ListItem(List=debrep_2.Faces, Index=Slider(0, range=0..100), Wrap=True)
line = Line(Line((11784.66906, 14861.11813, 0), (11784.66906, 14660.63948, 0)))
addition = Addition()
number_slider_9 = Slider(0, range=0..100)
number_slider_10 = Slider(0.39, range=0..1)
number_slider_11 = Slider(0.75, range=0..1)

# ---- group: 能耗模拟是否开启
toggle_2 = BooleanToggle(True)

# ---- group: 光伏发电计算是否开启?
toggle_3 = BooleanToggle(True)

# ---- group: 是否导入气象数据？
toggle_4 = BooleanToggle(True)

# ----
open_weather_file = Ladybug_OpenEPWWeatherFile(open=toggle_4)  # -> epwFile; plug-in component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
epwtoddy = LBEPWToDDY(weather_file=open_weather_file, write=Toggle(True))  # -> ddy_file; plug-in component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

importepw = Ladybug_ImportEpw(epwFile=open_weather_file)  # -> readMe, latitude, location, dryBulbTemperature, dewPointTemperature, relativeHumidity, windSpeed, windDirection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; plug-in component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
strnum = Ladybug_SeparateData(inputList=flatten(importepw.diffuseHorizontalRadiation))  # -> numbers, strings; plug-in component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
strnum_2 = Ladybug_SeparateData(inputList=flatten(importepw.dryBulbTemperature))  # -> numbers, strings; plug-in component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
strnum_3 = Ladybug_SeparateData(inputList=flatten(importepw.directNormalRadiation))  # -> numbers, strings; plug-in component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
strnum_4 = Ladybug_SeparateData(inputList=flatten(importepw.globalHorizontalRadiation))  # -> numbers, strings; plug-in component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
strnum_5 = Ladybug_SeparateData(inputList=flatten(importepw.windSpeed))  # -> numbers, strings; plug-in component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
strnum_6 = Ladybug_SeparateData(inputList=flatten(importepw.relativeHumidity))  # -> numbers, strings; plug-in component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
ghi = Panel(strnum_4.numbers)
dhi = Panel(strnum.numbers)
dni = Panel(strnum_3.numbers)
逐时相对湿度 = Panel(strnum_6.numbers)
逐时风速 = Panel(strnum_5.numbers)
逐时室外温度 = Panel(strnum_2.numbers)

sizingpar = HBSizingParameter(ddy_file=epwtoddy)  # -> sizing; plug-in component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
simpar = HBSimulationParameter(output=simoutput.sim_output, timestep=6, sizing=sizingpar)  # -> sim_par; plug-in component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
importepw_2 = LBImportEPW(epw_file=open_weather_file)  # -> location, dry_bulb_temperature, dew_point_temperature, relative_humidity, wind_speed, wind_direction, direct_normal_rad, diffuse_horizontal_rad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; plug-in component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

# ---- group: 时序数据是否导出？
toggle_5 = BooleanToggle(True)

# ---- group: 全年数据是否导出?
toggle_6 = BooleanToggle(True)

# ----
体型系数 = Panel(division)
S = Script(value=体型系数)  # -> out, result
# ---------- S: Python ----------
"""
输入：
    value: 任意类型（string、float、int 都可能）
输出：
    result: float 类型值（或 None）
"""

try:
    result = float(value)
except:
    result = None  # 或者给默认值，比如 result = 0.0
# ---------- end S ----------

# ---- group: 山东平均电力碳排放因子
number_slider_12 = Slider(0.5, range=0..1)

# ---- group: 围护结构传热系数设定
S_2 = Script(year=panel_8, shape_coef=S.result)  # -> out, U_wall, U_ground, U_window, U_roof, SHGC_window
# ---------- S_2: Python ----------
"""
输入：
    year: int 或 str，建设年份
    shape_coef: float 或 str，体型系数
输出：
    U_roof: 屋面传热系数
    U_wall: 外墙传热系数
    U_ground: 地面传热系数
    U_window: 外窗传热系数
    SHGC_window: 外窗太阳得热系数
"""

def get_u_values(year, shape_coef):
    # ---- ✅ 类型转换 ----
    try:
        year = int(year)
    except:
        return None, None, None, None, None
    
    try:
        shape_coef = float(shape_coef)
    except:
        return None, None, None, None, None

    # ---- 判断规范年份 ----
    if year <= 1985:
        standard = "1985"
    elif year <= 2005:
        standard = "2006"
    elif year <= 2018:
        standard = "2019"
    else:
        standard = "2025"

    # ---- 判断体型系数 ----
    if shape_coef < 0.3:
        coef = "<0.3"
    elif shape_coef <= 0.5:
        coef = "0.3~0.5"
    else:
        coef = ">0.5"

    # ---- U值表 ----
    U_values = {
        "1985": {
            "0.3~0.5": [0.91, 1.28, 2.0, 6.4]
        },
        "2006": {
            "0.3~0.5": [0.45, 0.50, 1.5, 2.0]
        },
        "2019": {
            "<0.3":     [0.40, 0.50, 1.0, 1.8],
            "0.3~0.5":  [0.35, 0.45, 1.0, 1.6]
        },
        "2025": {
            "<0.3":     [0.15, 0.37, 1.0, 1.3],
            "0.3~0.5":  [0.15, 0.37, 1.0, 1.3]
        }
    }

    SHGC_values = {
        "1985": 0.60,
        "2006": 0.60,
        "2019": 0.40,
        "2025": {
            "<0.3": 0.35,
            "0.3~0.5": 0.45
        }
    }

    if standard in ["1985", "2006"]:
        coef_key = "0.3~0.5"
    else:
        coef_key = coef if coef in U_values[standard] else "0.3~0.5"

    U_roof, U_wall, U_ground, U_window = U_values[standard][coef_key]

    if isinstance(SHGC_values[standard], dict):
        SHGC_window = SHGC_values[standard].get(coef_key, 0.45)
    else:
        SHGC_window = SHGC_values[standard]

    return U_roof, U_wall, U_ground, U_window, SHGC_window

# 调用函数
U_roof, U_wall, U_ground, U_window, SHGC_window = get_u_values(year, shape_coef)
# ---------- end S_2 ----------
split = SplitList(List=["0.15", "0.53", "1.0", "1.4"], Index=Slider(0, range=0..1))  # -> ListA, ListB
division_2 = Division(A=Slider(1, range=0..1), B=split.ListA)
panel_13 = Panel(split.ListB)
windowmat = HBWindowMaterial(name="window", u_factor=S_2.U_window, shgc=S_2.SHGC_window)  # -> mat; plug-in component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
windowconstr = HBWindowConstruction(materials=windowmat)  # -> constr; plug-in component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
subfacesubset = HBSubfaceSubset(window=windowconstr)  # -> subface_set; plug-in component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

division_3 = Division(A="1", B=S_2.U_wall)

division_4 = Division(A="1", B=S_2.U_roof)

division_5 = Division(A="1", B=S_2.U_ground)

opaquematnomass = HBOpaqueMaterialNoMass(name="wall", r_value=division_3)  # -> mat; plug-in component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
opaquematnomass_2 = HBOpaqueMaterialNoMass(name="ground", r_value=division_5)  # -> mat; plug-in component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
opaquematnomass_3 = HBOpaqueMaterialNoMass(name="roof", r_value=division_4)  # -> mat; plug-in component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
opaqueconstr = HBOpaqueConstruction(materials=opaquematnomass_3)  # -> constr; plug-in component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
opaqueconstr_2 = HBOpaqueConstruction(materials=opaquematnomass)  # -> constr; plug-in component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
opaqueconstr_3 = HBOpaqueConstruction(materials=opaquematnomass_2)  # -> constr; plug-in component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
exteriorsubset = HBExteriorConstructionSubset(exterior_wall=opaqueconstr_2, exterior_roof=opaqueconstr)  # -> exterior_set; plug-in component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
groundsubset = HBGroundConstructionSubset(ground_floor=opaqueconstr_3)  # -> ground_set; plug-in component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
constructionset = HBConstructionSet(exterior_subset=exteriorsubset, ground_subset=groundsubset, subface_subset=subfacesubset)  # -> constr_set; plug-in component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

# ----
panel_14 = Panel(S_2.U_window)
panel_15 = Panel(S_2.U_ground)
panel_16 = Panel(S_2.SHGC_window)
panel_17 = Panel(S_2.U_roof)
panel_18 = Panel(S_2.U_wall)
buildingsolid = DFBuildingFromSolid(bldg_geo=flatten(geo_3), floor_to_floor=建筑层高, program=programtype, constr_set=constructionset, run=Toggle(True))  # -> report, buildings; plug-in component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
applyfacadepar = DFApplyFacadeParameters(df_obj=buildingsolid.buildings, win_par=simpleratiopar)  # -> report, df_obj; plug-in component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
topbottom = DFSeparateTopBottom(buildings=flatten(applyfacadepar.df_obj))  # -> buildings; plug-in component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
decnstrdf = DFDeconstructObject(df_obj=topbottom)  # -> stories, room2ds; plug-in component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
idealair = HBIdealAir(rooms=flatten(decnstrdf.room2ds))  # -> report, rooms; plug-in component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
rejoin = DFRejoinToBuilding(room2ds=flatten(idealair.rooms))  # -> buildings; plug-in component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
solveadj2d = DFSolveAdjacency(df_objs=rejoin, run=Toggle(True))  # -> report, df_objs; plug-in component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
model = DFModel(buildings=flatten(solveadj2d.df_objs))  # -> report, model; plug-in component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
tohoneybee = DFModelToHoneybee(model=model.model, run=Toggle(True))  # -> report, hb_models; plug-in component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
vizwiref = HBVisualizeWireframe(hb_objs=flatten(tohoneybee.hb_models))  # -> geo; plug-in component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
vizbytype = HBVisualizeByType(hb_objs=tohoneybee.hb_models)  # -> walls, interior_walls, roofs, ceilings, exterior_floors, interior_floors, air_walls, apertures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; plug-in component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
deconstructmodel = HBDeconstructModel(model=tohoneybee.hb_models)  # -> rooms, faces, apertures, doors, shades; plug-in component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
modeltoosm = HBModelToOSM(model=tohoneybee.hb_models, epw_file=open_weather_file, sim_par=simpar, write=toggle_2, run=toggle_2)  # -> report, jsons, osw, osm, idf, sql, zsz, rdd, html; plug-in component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
roomenergyresult = HBReadRoomEnergyResult(sql=modeltoosm.sql)  # -> cooling, heating, lighting, electric_equip, gas_equip, process, hot_water, fan_electric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; plug-in component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
xdata = LBDeconstructData(data=roomenergyresult.cooling)  # -> header, values; plug-in component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
xdata_2 = LBDeconstructData(data=roomenergyresult.heating)  # -> header, values; plug-in component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
xdata_3 = LBDeconstructData(data=roomenergyresult.lighting)  # -> header, values; plug-in component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
bang = ExplodeTree(Data=xdata_2.values)  # -> flatten(_0000), flatten(_0001), flatten(Branch2)
bang_2 = ExplodeTree(Data=xdata_3.values)  # -> flatten(_0000), flatten(_0001), flatten(Branch2)
bang_3 = ExplodeTree(Data=xdata.values)  # -> flatten(_0000), flatten(_0001), flatten(Branch2)
addition_2 = Addition(A=bang_3._0000, B=bang_3._0001, C=bang_3.Branch2)
panel_19 = Panel(addition_2)
addition_3 = Addition(A=bang._0000, B=bang._0001, C=bang.Branch2)
addition_4 = Addition(A=bang_2._0000, B=bang_2._0001, C=bang_2.Branch2)
逐时照明能耗 = Panel(addition_4)
逐时采暖能耗 = Panel(addition_3)

eui = HBEndUseIntensity(sql=modeltoosm.sql)  # -> eui, eui_end_use, end_uses, gross_floor; plug-in component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
空调机组cop值 = Slider(3, range=0..10)
panel_20 = Panel(eui.eui_end_use)

# ---- group: 制冷能耗
item_9 = ListItem(List=eui.eui_end_use, Index=Slider(1, range=0..100), Wrap=True)

# ---- group: 照明能耗
item_10 = ListItem(List=eui.eui_end_use, Index=Slider(2, range=0..100), Wrap=True)  # -> flatten(Item)

# ---- group: 采暖能耗
item_11 = ListItem(List=eui.eui_end_use, Index=Slider(0, range=0..100), Wrap=True)

# ----
panel_21 = Panel(item_11)
panel_22 = Panel(item_9)
division_6 = Division(A=panel_22, B=空调机组cop值)

avr = Average(Input=item_10)
division_7 = Division(A=panel_19, B=空调机组cop值)
逐时制冷能耗 = Panel(division_7)
addition_5 = Addition(A=逐时制冷能耗, B=逐时采暖能耗, C=逐时照明能耗)
教学楼建筑面积 = Panel(eui.gross_floor)
addition_6 = Addition(A=教学楼建筑面积)
division_8 = Division(A=教学楼建筑面积, B=建筑层数)
建筑占地面积 = Panel(division_8)

path = Panel("C:\Users\DELL\Desktop\6-15 Simulation.xlsx")
merge = Merge(
    Data1="教学楼序号",
    Data2="屋顶总发电量",
    Data3="屋顶光伏发电总面积",
    Data4="屋顶单位面积发电量",
    Data5="照明能耗",
    Data6="制冷能耗",
    Data7="采暖能耗",
    Data8="单位面积总能耗",
    Data9="教学楼总建筑能耗",
    Data10="碳排放强度值（未考虑光伏）",
    Data11="碳排放强度值（考虑光伏）",
    Data12="减碳率",
    Data13="不加光伏的全年总电费",
    Data14="加光伏的全年总电费",
    Data15="全年余电上网收益",
    Data16="加光伏的全年净电费",
    Data17="加光伏节省电费",
    Data18="节省率")
wo = WriteOptions(
    FilePath=path,
    ClearDataOverwrite=Toggle(True),
    SaveAfterWrite=Toggle(True),
    CloseAfterWrite=Toggle(True),
    ColumnStartPosition=1,
    RowStartPosition=Slider(1, range=1..10, expression="x*2"))  # -> UserMessages, WriteOptions
panel_23 = Panel(merge)

simplifiedphotovoltaicsmodule = Ladybug_SimplifiedPhotovoltaicsModule(
    mountType=Slider(0, range=0..1),
    moduleEfficiency=Slider(16.19, range=0..100),
    temperatureCoefficient=-0.5,
    moduleActiveAreaPercent=Slider(80, range=0..100))  # -> readMe, PVmoduleSettings; plug-in component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
simplifiedphotovoltaicsmodule_2 = Ladybug_SimplifiedPhotovoltaicsModule(
    mountType=Slider(2, range=0..10),
    moduleEfficiency=Slider(16.19, range=0..100),
    temperatureCoefficient=-0.5,
    moduleActiveAreaPercent=Slider(90, range=0..100))  # -> readMe, PVmoduleSettings; plug-in component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
geo_5 = Geometry(py3.Roof)
geo_6 = Geometry(geo_5)
geo_7 = Geometry(geo_2)
number_slider_13 = Slider(1, range=0..1)
photovoltaicssurface = Ladybug_PhotovoltaicsSurface(
    epwFile=open_weather_file,
    PVsurface=graft(geo_7),
    PVsurfacePercent=Slider(20, range=0..100),
    DCtoACderateFactor=0.85,
    PVmoduleSettings=simplifiedphotovoltaicsmodule.PVmoduleSettings,
    north=0,
    runIt=Slider(0, range=0..1))  # -> readMe, port, ACenergyPerHour, ACenergyPerYear, averageDailyACenergyPerYear, port_2, DCenergyPerHour, totalRadiationPerHour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; plug-in component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
area_4 = Area(Geometry=geo_6)  # -> flatten(Area), Centroid
photovoltaicssurface_2 = Ladybug_PhotovoltaicsSurface(
    epwFile=open_weather_file,
    PVsurface=graft(geo_6),
    PVsurfacePercent=Slider(20, range=1..565),
    DCtoACderateFactor=0.85,
    PVmoduleSettings=simplifiedphotovoltaicsmodule_2.PVmoduleSettings,
    north=0,
    runIt=toggle_3)  # -> readMe, port, ACenergyPerHour, ACenergyPerYear, averageDailyACenergyPerYear, port_2, DCenergyPerHour, totalRadiationPerHour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; plug-in component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
ma_2 = MassAddition(Input=area_4.Area)  # -> Result, PartialResults
ma_3 = MassAddition(Input=flatten(photovoltaicssurface_2.ACenergyPerYear))  # -> Result, PartialResults
photovoltaicsperformancemetrics = Ladybug_PhotovoltaicsPerformanceMetrics(
    PVsurface=graft(geo_6),
    PVsurfacePercent="100",
    PVmoduleSettings=["close roof mount", "c-Si", 1, 90, 15, -0.5, -2.98, -0.0471, 1],
    ACenergyPerHour=photovoltaicssurface_2.ACenergyPerHour,
    totalRadiationPerHour=photovoltaicssurface_2.totalRadiationPerHour,
    cellTemperaturePerHour=photovoltaicssurface_2.cellTemperaturePerHour,
    energyCostPerKWh=0.15,
    embodiedEnergyPerM2="4410",
    embodiedCO2PerM2="225",
    gridEfficiency=29,
    optimal=False,
    runIt=Slider(1, range=0..1))  # -> readMe, optimalSystemSize, port, CUFperYear, basicPRperYear, temperatureCorrectedPRperMonth, temperatureCorrectedPRperYear, port_2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; disabled; plug-in component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
number_slider_14 = Slider(0.7, range=0..1)
panel_24 = Panel(photovoltaicsperformancemetrics.EPBT)

panel_25 = Panel(photovoltaicssurface_2.ACenergyPerHour)
strnum_7 = Ladybug_SeparateData(inputList=flatten(panel_25))  # -> numbers, strings; plug-in component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

area_5 = Area(Geometry=geo_7)  # -> flatten(Area), Centroid
ma_4 = MassAddition(Input=flatten(photovoltaicssurface.ACenergyPerYear))  # -> Result, PartialResults
ma_5 = MassAddition(Input=area_5.Area)  # -> Result, PartialResults

panel_26 = Panel(ma_5.Result)
panel_27 = Panel(ma_4.Result)

photovoltaicsperformancemetrics_2 = Ladybug_PhotovoltaicsPerformanceMetrics(
    PVsurface=graft(geo_7),
    PVsurfacePercent="100",
    PVmoduleSettings=["close roof mount", "c-Si", 1, 90, 15, -0.5, -2.98, -0.0471, 1],
    ACenergyPerHour=photovoltaicssurface.ACenergyPerHour,
    totalRadiationPerHour=photovoltaicssurface.totalRadiationPerHour,
    cellTemperaturePerHour=photovoltaicssurface.cellTemperaturePerHour,
    energyCostPerKWh=0.15,
    embodiedEnergyPerM2="4410",
    embodiedCO2PerM2="225",
    lifetime=Slider(25, range=0..100),
    gridEfficiency=29,
    optimal=False,
    runIt=Slider(1, range=0..1))  # -> readMe, optimalSystemSize, port, CUFperYear, basicPRperYear, temperatureCorrectedPRperMonth, temperatureCorrectedPRperYear, port_2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; plug-in component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
multiplication = Multiplication(A=panel_27, B=number_slider_14)
multiplication_2 = Multiplication(A=panel_26, B=number_slider_14)

南立面总发电量 = Panel(multiplication)
南立面光伏发电总面积 = Panel(multiplication_2)

# ---- group: 南立面单位面积发电量
division_9 = Division(A=南立面总发电量, B=南立面光伏发电总面积)

# ----
南立面单位面积发电量 = Panel(division_9)

# ---- group: 逐时性能评价指标
逐时总能耗 = Panel(addition_5)
光伏系统逐时产能量 = Panel(strnum_7.numbers)

# ----
subtraction_2 = Subtraction(A=光伏系统逐时产能量, B=逐时总能耗)
max = Maximum(A=subtraction_2, B=number_slider_9)
subtraction_3 = Subtraction(A=逐时总能耗, B=光伏系统逐时产能量)
min = Minimum(A=光伏系统逐时产能量, B=逐时总能耗)
max_2 = Maximum(A=subtraction_3, B=number_slider_9)
multiplication_3 = Multiplication(A=逐时总能耗, B=number_slider_11)
ma_6 = MassAddition(Input=逐时总能耗)  # -> Result, PartialResults
multiplication_4 = Multiplication(A=number_slider_11, B=ma_6.Result)

# ---- group: 逐时性能评价指标 (continued)
电网购电量 = Panel(max_2)
余电上网量 = Panel(max)
光伏自用量 = Panel(min)
不加光伏电费_逐时 = Panel(multiplication_3)

# ----
ma_7 = MassAddition(Input=余电上网量)  # -> Result, PartialResults
multiplication_5 = Multiplication(A=电网购电量, B=Slider(0.5, range=0..1))
multiplication_6 = Multiplication(A=电网购电量, B=number_slider_11)
ma_8 = MassAddition(Input=电网购电量)  # -> Result, PartialResults
multiplication_7 = Multiplication(A=ma_7.Result, B=number_slider_10)
multiplication_8 = Multiplication(A=余电上网量, B=number_slider_10)
multiplication_9 = Multiplication(A=number_slider_11, B=ma_8.Result)

# ---- group: 逐时性能评价指标 (continued)
逐时运行碳排放 = Panel(multiplication_5)
余电上网收益_逐时 = Panel(multiplication_8)
加光伏的电费_逐时 = Panel(multiplication_6)

# ----
subtraction_4 = Subtraction(A=加光伏的电费_逐时, B=余电上网收益_逐时)

# ---- group: 逐时性能评价指标 (continued)
加光伏净电费_逐时 = Panel(subtraction_4)

# ----
merge_2 = Merge(
    Data1=graft(hourindex),
    Data2=graft(datetime),
    Data3=graft(day_of_year),
    Data4=graft(hour_of_day),
    Data5=graft(逐时室外温度),
    Data6=graft(逐时相对湿度),
    Data7=graft(逐时风速),
    Data8=graft(dni),
    Data9=graft(dhi),
    Data10=graft(ghi),
    Data11=graft(逐时总能耗),
    Data12=graft(光伏系统逐时产能量),
    Data13=graft(电网购电量),
    Data14=graft(余电上网量),
    Data15=graft(光伏自用量),
    Data16=graft(逐时运行碳排放),
    Data17=graft(余电上网收益_逐时),
    Data18=graft(加光伏的电费_逐时),
    Data19=graft(不加光伏电费_逐时),
    Data20=graft(加光伏净电费_逐时))
merge_3 = Merge(
    Data1="HourIndex",
    Data2="DateTime",
    Data3="Day of year",
    Data4="Hour of day",
    Data5="Temperature",
    Data6="Humidity",
    Data7="Wind speed",
    Data8="Direct normal radiation",
    Data9="Diffuse horizontal radiation",
    Data10="Global horizontal radiation",
    Data11="建筑逐时能耗",
    Data12="光伏系统逐时发电量",
    Data13="电网购电量",
    Data14="余电上网量",
    Data15="光伏自用量",
    Data16="逐时运行碳排放",
    Data17="余电上网收益",
    Data18="不加光伏的电费",
    Data19="加光伏系统的电费",
    Data20="净电费（加入光伏系统）")
path_2 = Panel(panel_12)
panel_28 = Panel(merge_2)
wo_2 = WriteOptions(
    FilePath=path_2,
    ClearDataOverwrite=Toggle(True),
    SaveAfterWrite=Toggle(True),
    CloseAfterWrite=Toggle(True),
    ColumnStartPosition=1,
    RowStartPosition=Slider(1, range=1..10, expression="x*2"))  # -> UserMessages, WriteOptions
panel_29 = Panel(merge_3)
rec = DataRecorder(panel_28, DataLimit=6000, RecordData=True)
panel_30 = Panel(rec)
writexl = WriteToExcel(
    Run=toggle_5,
    ExcelWorksheet="1",
    ColumnNames=panel_29,
    WriteOptions=wo_2.WriteOptions,
    ColumnnsOrRows=Toggle(True),
    DataToWriteIntoColumns=panel_28)
panel_31 = Panel(writexl)

# ---- group: 年度总量评价指标
屋顶总发电量 = Panel(ma_3.Result)
不加光伏的全年总电费 = Panel(multiplication_4)
照明能耗 = Panel(avr)
制冷能耗 = Panel(division_6)
加光伏的全年总电费 = Panel(multiplication_9)
全年余电上网收益 = Panel(multiplication_7)
制热能耗 = Panel(panel_21)
屋顶光伏发电总面积 = Panel(ma_2.Result)

# ----
addition_7 = Addition(A=制热能耗, B=制冷能耗, C=照明能耗)
subtraction_5 = Subtraction(A=加光伏的全年总电费, B=全年余电上网收益)

# ---- group: 屋顶单位面积发电量
division_10 = Division(A=屋顶总发电量, B=屋顶光伏发电总面积)

# ---- group: 年度总量评价指标 (continued)
加光伏的全年净电费 = Panel(subtraction_5)
屋顶单位面积发电量 = Panel(division_10)
单位面积总能耗 = Panel(addition_7)

# ----
subtraction_6 = Subtraction(A=不加光伏的全年总电费, B=加光伏的全年净电费)

# ---- group: 年度总量评价指标 (continued)
加光伏节省电费 = Panel(subtraction_6)

# ----
division_11 = Division(A=加光伏节省电费, B=不加光伏的全年总电费)
multiplication_10 = Multiplication(A=division_11, B=Slider(100, range=0..100))

# ---- group: 年度总量评价指标 (continued)
节省率 = Panel(multiplication_10)

# ----
multiplication_11 = Multiplication(A=单位面积总能耗, B=教学楼建筑面积)  # -> flatten(Result)

# ---- group: 年度总量评价指标 (continued)
教学楼总建筑能耗 = Panel(multiplication_11)

# ----
subtraction_7 = Subtraction(A=教学楼总建筑能耗, B=屋顶总发电量)
multiplication_12 = Multiplication(A=subtraction_7, B=number_slider_12)
multiplication_13 = Multiplication(A=教学楼总建筑能耗, B=number_slider_12)
division_12 = Division(A=multiplication_12, B=教学楼建筑面积)
division_13 = Division(A=multiplication_13, B=教学楼建筑面积)

# ---- group: 年度总量评价指标 (continued)
碳排放强度值_考虑光伏发电 = Panel(division_12)
碳排放强度值_未考虑光伏发电 = Panel(division_13)

# ----
subtraction_8 = Subtraction(A=碳排放强度值_未考虑光伏发电, B=碳排放强度值_考虑光伏发电)
division_14 = Division(A=subtraction_8, B=碳排放强度值_未考虑光伏发电)
panel_32 = Panel(division_14)
multiplication_14 = Multiplication(A=panel_32, B=Slider(100, range=0..100))

# ---- group: 年度总量评价指标 (continued)
减碳率 = Panel(multiplication_14)

# ----
merge_4 = Merge(
    Data1=flatten(panel_4),
    Data2=flatten(屋顶总发电量),
    Data3=flatten(屋顶光伏发电总面积),
    Data4=flatten(屋顶单位面积发电量),
    Data5=flatten(照明能耗),
    Data6=flatten(制冷能耗),
    Data7=flatten(制热能耗),
    Data8=flatten(单位面积总能耗),
    Data9=flatten(教学楼总建筑能耗),
    Data10=flatten(碳排放强度值_未考虑光伏发电),
    Data11=flatten(碳排放强度值_考虑光伏发电),
    Data12=flatten(减碳率),
    Data13=flatten(不加光伏的全年总电费),
    Data14=flatten(加光伏的全年总电费),
    Data15=flatten(全年余电上网收益),
    Data16=flatten(加光伏的全年净电费),
    Data17=flatten(加光伏节省电费),
    Data18=flatten(节省率))  # -> graft(Result)

panel_33 = Panel(merge_4)
rec_2 = DataRecorder(panel_33, DataLimit=6000, RecordData=True)
panel_34 = Panel(rec_2)
writexl_2 = WriteToExcel(
    Run=toggle_6,
    ExcelWorksheet="1",
    ColumnNames=panel_23,
    WriteOptions=wo.WriteOptions,
    ColumnnsOrRows=Toggle(False),
    DataToWriteIntoColumns=panel_34)
panel_35 = Panel(writexl_2)
