# Grasshopper definition Simulation_base.gh (Grasshopper 1.0.8)
# plug-ins: TT Toolbox

cluster = Cluster()
cluster_2 = Cluster()
cluster_3 = Cluster()
cluster_4 = Cluster()
cluster_5 = Cluster()
cluster_6 = Cluster()
cluster_7 = Cluster()
cluster_8 = Cluster()
cluster_9 = Cluster()
cluster_10 = Cluster()
cluster_11 = Cluster()
cluster_12 = Cluster()
cluster_13 = Cluster()
cluster_14 = Cluster()
cluster_15 = Cluster()
cluster_16 = Cluster()
cluster_17 = Cluster()
cluster_18 = Cluster()
cluster_19 = Cluster()
cluster_20 = Cluster()
体型系数 = Slider(0.3, range=0..1)

# ---- group: 通风
genes = GenePool(Decimals=0, Maximum=1, Minimum=0, Value=[1, 1, 1, 1, 1, 1, 1, 1, 1, 1, 1, 1, 1, 1, 1, 1, 1, 1, 1, 1, 1, 1, 0, 0])
weeklyschedule = HBWeeklySchedule(sun=genes, mon=genes, tue=genes, wed=genes, thu=genes, fri=genes, sat=genes)  # -> report, schedule, idf_year, idf_week, idf_days; plug-in component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

# ---- group: 人员在室率
genes_2 = GenePool(Decimals=0, Maximum=1, Minimum=0, Value=[0, 0, 0, 0, 0, 0, 0, 1, 1, 1, 1, 1, 1, 1, 1, 1, 1, 1, 1, 0, 0, 0, 0, 0])
weeklyschedule_2 = HBWeeklySchedule(sun=genes_2, mon=genes_2, tue=genes_2, wed=genes_2, thu=genes_2, fri=genes_2, sat=genes_2)  # -> report, schedule, idf_year, idf_week, idf_days; plug-in component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

# ---- group: 采暖时间表
genes_3 = GenePool(
    Decimals=0,
    Maximum=100,
    Minimum=0,
    Value=[18, 18, 18, 18, 18, 18, 18, 18, 18, 18, 18, 18, 18, 18, 18, 18, 18, 18, 18, 18, 18, 18, 18, 18])
panel = Panel("Temperature")
weeklyschedule_3 = HBWeeklySchedule(sun=genes_3, mon=genes_3, tue=genes_3, wed=genes_3, thu=genes_3, fri=genes_3, sat=genes_3, name="Heat", type_limit=panel)  # -> report, schedule, idf_year, idf_week, idf_days; plug-in component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

# ---- group: 人员在室率
genes_4 = GenePool(Decimals=0, Maximum=1, Minimum=0, Value=[0, 0, 0, 0, 0, 0, 0, 1, 1, 1, 1, 0, 0, 0, 0, 0, 0, 1, 1, 1, 1, 1, 0, 0])
weeklyschedule_4 = HBWeeklySchedule(sun=genes_4, mon=genes_4, tue=genes_4, wed=genes_4, thu=genes_4, fri=genes_4, sat=genes_4)  # -> report, schedule, idf_year, idf_week, idf_days; plug-in component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

# ---- group: 制冷时间表
genes_5 = GenePool(
    Decimals=0,
    Maximum=100,
    Minimum=0,
    Value=[35, 35, 35, 35, 35, 35, 35, 26, 26, 26, 26, 26, 26, 26, 26, 26, 26, 26, 26, 35, 35, 35, 35, 35])
panel_2 = Panel("Temperature")
weeklyschedule_5 = HBWeeklySchedule(
    sun=genes_5,
    mon=genes_5,
    tue=genes_5,
    wed=genes_5,
    thu=genes_5,
    fri=genes_5,
    sat=genes_5,
    name="cool",
    type_limit=panel_2)  # -> report, schedule, idf_year, idf_week, idf_days; plug-in component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

# ----
constantschedule = HBConstantSchedule(values=Slider(25, range=0..100), type_limit=panel)  # -> report, schedule, idf_text; plug-in component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
analysisperiod = LBAnalysisPeriod(
    start_month=Slider(11, range=-11..50),
    start_day=Slider(15, range=0..100),
    start_hour=0,
    end_month=Slider(12, range=0..12),
    end_day=Slider(31, range=0..100))  # -> period, hoys, dates; plug-in component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
analysisperiod_2 = LBAnalysisPeriod(
    start_month=Slider(1, range=-11..50),
    start_day=Slider(1, range=0..1),
    start_hour=0,
    end_month=Slider(3, range=0..10),
    end_day=Slider(15, range=0..100))  # -> period, hoys, dates; plug-in component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
seasonalschedule = HBSeasonalSchedule(base_schedule=constantschedule.schedule, season_scheds=weeklyschedule_3.schedule, analysis_periods=analysisperiod.period)  # -> out, schedule, idf_year, idf_week, idf_days; plug-in component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
seasonalschedule_2 = HBSeasonalSchedule(
    base_schedule=seasonalschedule.schedule,
    season_scheds=weeklyschedule_3.schedule,
    analysis_periods=analysisperiod_2.period)  # -> out, schedule, idf_year, idf_week, idf_days; plug-in component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

constantschedule_2 = HBConstantSchedule(values=Slider(26, range=0..100), type_limit=panel_2)  # -> report, schedule, idf_text; plug-in component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
analysisperiod_3 = LBAnalysisPeriod(
    start_month=Slider(6, range=0..10),
    start_day=Slider(1, range=0..1),
    start_hour=0,
    end_month=Slider(7, range=0..10),
    end_day=Slider(1, range=0..1))  # -> period, hoys, dates; plug-in component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
seasonalschedule_3 = HBSeasonalSchedule(
    base_schedule=constantschedule_2.schedule,
    season_scheds=weeklyschedule_5.schedule,
    analysis_periods=analysisperiod_3.period)  # -> out, schedule, idf_year, idf_week, idf_days; plug-in component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

number_slider = Slider(6.5, range=0..10)

setpoint = HBSetpoint(heating_sch=seasonalschedule_2.schedule, cooling_sch=seasonalschedule_3.schedule)  # -> setpoint; plug-in component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
people = HBPeople(ppl_per_area=Slider(0.04, range=0..0.1), occupancy_sch=weeklyschedule_2.schedule)  # -> people; plug-in component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
lighting = HBLighting(watts_per_area=Slider(3, range=0..10), schedule=weeklyschedule_4.schedule)  # -> lighting; plug-in component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
ventilation = HBVentilation(flow_per_person=Slider(0.00833, range=0..0.01), ach=Slider(0.5, range=0..1), schedule=weeklyschedule.schedule)  # -> vent; plug-in component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
programtype = HBProgramType(name="school", people=people, lighting=lighting, ventilation=ventilation, setpoint=setpoint)  # -> program; plug-in component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

number_slider_2 = Slider(0.5, range=0..1)

panel_3 = Panel("A.年代")  # disabled
panel_4 = Panel("B 屋顶传热系数")  # disabled
panel_5 = Panel("C 外墙传热系数")  # disabled
panel_6 = Panel("D 地面传热系数")  # disabled
panel_7 = Panel("F 外窗SHGC")  # disabled
panel_8 = Panel("E 外窗传热系数")  # disabled

facparam = HBFacadeParameters(north=number_slider_2, east=number_slider_2, south=number_slider_2, west=number_slider_2)  # -> fac_par; plug-in component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
simpleratiopar = DFSimpleWindowRatioParameters(ratio=facparam)  # -> win_par; plug-in component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
toggle = BooleanToggle(False)
ladybug = Ladybug_Ladybug()  # -> Vviiiiiiiiiizzz; plug-in component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
simoutput = HBSimulationOutput(zone_energy_use=toggle, system_energy_use=toggle, report_frequency="Monthly")  # -> report, sim_output; plug-in component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
toggle_2 = BooleanToggle(False)  # disabled
path = Panel("C:\Users\Chevalier.Chen\Desktop\1.xlsx")
merge = Merge(
    Data1="A.建筑面积",
    Data2="B 朝向",
    Data3="C 教学楼占地面积",
    Data4="D 学校场地面积",
    Data5="E 建筑密度",
    Data6="F 容积率",
    Data7="G 体型系数",
    Data8="H 制冷能耗",
    Data9="I 采暖能耗",
    Data10="J 照明能耗",
    Data11="K 单位面积总能耗")
wo = WriteOptions(
    FilePath=path,
    ClearDataOverwrite=Toggle(False),
    SaveAfterWrite=Toggle(True),
    CloseAfterWrite=Toggle(False),
    ColumnStartPosition=1,
    RowStartPosition=Slider(1, range=1..10, expression="x*2"))  # -> UserMessages, WriteOptions
path_2 = Panel("C:\Users\Chevalier.Chen\Desktop\11111.xlsx")
panel_9 = Panel(wo.UserMessages)
addition = Addition()
line = Line(Line((11784.66906, 14861.11813, 0), (11784.66906, 14660.63948, 0)))
readxl = ReadExcelSheet(Run=Toggle(True), FilePath=path_2, Worksheet="1", Listen=False)  # -> UserMessages, Columns, Rows
panel_10 = Panel(merge)
panel_11 = Panel(readxl.Columns)
item = ListItem(List=readxl.Columns, Index=Slider(1, range=1..151), Wrap=True)
open_weather_file = Ladybug_OpenEPWWeatherFile(open=Slider(1, range=0..1))  # -> epwFile; plug-in component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
epwtoddy = LBEPWToDDY(weather_file=open_weather_file, write=Toggle(True))  # -> ddy_file; plug-in component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
sizingpar = HBSizingParameter(ddy_file=epwtoddy)  # -> sizing; plug-in component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
importepw = Ladybug_ImportEpw(epwFile=open_weather_file)  # -> readMe, latitude, location, dryBulbTemperature, dewPointTemperature, relativeHumidity, windSpeed, windDirection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; plug-in component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
simpar = HBSimulationParameter(output=simoutput.sim_output, timestep=6, sizing=sizingpar)  # -> sim_par; plug-in component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
strnum = Ladybug_SeparateData(inputList=flatten(importepw.dryBulbTemperature))  # -> numbers, strings; plug-in component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
strnum_2 = Ladybug_SeparateData(inputList=flatten(importepw.directNormalRadiation))  # -> numbers, strings; plug-in component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
strnum_3 = Ladybug_SeparateData(inputList=flatten(importepw.relativeHumidity))  # -> numbers, strings; plug-in component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
strnum_4 = Ladybug_SeparateData(inputList=flatten(importepw.windSpeed))  # -> numbers, strings; plug-in component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
avr = Average(Input=strnum.numbers)
avr_2 = Average(Input=strnum_2.numbers)
avr_3 = Average(Input=strnum_3.numbers)
avr_4 = Average(Input=strnum_4.numbers)
平均温度 = Panel(avr)
平均太阳辐射 = Panel(avr_2)
平均风速 = Panel(avr_4)
平均相对湿度 = Panel(avr_3)
simplifiedphotovoltaicsmodule = Ladybug_SimplifiedPhotovoltaicsModule(
    mountType=Slider(1, range=0..1),
    moduleEfficiency=Slider(16.19, range=0..100),
    temperatureCoefficient=-0.5,
    moduleActiveAreaPercent=Slider(90, range=0..100))  # -> readMe, PVmoduleSettings; plug-in component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

# ---- group: 是否开始模拟
toggle_3 = BooleanToggle(False)

# ---- group: 除教学楼外的建筑体块
geo = Geometry(<extrusion referenced from the Rhino model>)  # disabled

# ----
debrep = DeconstructBrep(Brep=geo)  # -> Faces, Edges, Vertices
item_2 = ListItem(List=debrep.Faces, Index=Slider(0, range=0..100), Wrap=True)
geo_2 = Geometry(flatten(item_2))
area = Area(Geometry=geo_2)  # -> Area, Centroid
ma = MassAddition(Input=area.Area)  # -> Result, PartialResults
其他体块占地面积 = Panel(ma.Result)
建设年代 = Slider(2018, range=0..10000)
建筑层数 = Slider(4, range=3..8)
multiplication = Multiplication(A=ma.Result, B=建筑层数)
其他体块总建筑面积 = Panel(multiplication)
建筑层高 = Panel("@3.4125")
geo_3 = Geometry([<curve referenced from the Rhino model> x14])
importepw_2 = LBImportEPW(epw_file=open_weather_file)  # -> location, dry_bulb_temperature, dew_point_temperature, relative_humidity, wind_speed, wind_direction, direct_normal_rad, diffuse_horizontal_rad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; plug-in component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
photovoltaicssurface = Ladybug_PhotovoltaicsSurface(
    epwFile=open_weather_file,
    PVsurface=graft(geo_3),
    PVsurfacePercent=100,
    DCtoACderateFactor=0.85,
    PVmoduleSettings=simplifiedphotovoltaicsmodule.PVmoduleSettings,
    north=0,
    runIt=Slider(1, range=0..1))  # -> readMe, port, ACenergyPerHour, ACenergyPerYear, averageDailyACenergyPerYear, port_2, DCenergyPerHour, totalRadiationPerHour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; plug-in component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

area_2 = Area(Geometry=geo_3)  # -> flatten(Area), Centroid
ma_2 = MassAddition(Input=flatten(photovoltaicssurface.ACenergyPerYear))  # -> Result, PartialResults
ma_3 = MassAddition(Input=area_2.Area)  # -> Result, PartialResults

总发电量 = Panel(ma_2.Result)
光伏发电总面积 = Panel(ma_3.Result)

photovoltaicsperformancemetrics = Ladybug_PhotovoltaicsPerformanceMetrics(
    PVsurface=graft(geo_3),
    PVsurfacePercent="100",
    PVmoduleSettings=["close roof mount", "c-Si", 1, 90, 15, -0.5, -2.98, -0.0471, 1],
    ACenergyPerHour=photovoltaicssurface.ACenergyPerHour,
    totalRadiationPerHour=photovoltaicssurface.totalRadiationPerHour,
    cellTemperaturePerHour=photovoltaicssurface.cellTemperaturePerHour,
    energyCostPerKWh=0.15,
    embodiedEnergyPerM2="4410",
    embodiedCO2PerM2="225",
    gridEfficiency=29,
    optimal=False,
    runIt=Slider(1, range=0..1))  # -> readMe, optimalSystemSize, port, CUFperYear, basicPRperYear, temperatureCorrectedPRperMonth, temperatureCorrectedPRperYear, port_2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; plug-in component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
swatch = ColourSwatch(SwatchColor=RGB(255, 255, 255))

# ---- group: 场地体块
geo_4 = Geometry(<surface referenced from the Rhino model>)

# ----
area_3 = Area(Geometry=geo_4)  # -> Area, Centroid
场地面积 = Panel(area_3.Area)

# ---- group: 建筑体块
geo_5 = Geometry(<brep referenced from the Rhino model>)

# ----
debrep_2 = DeconstructBrep(Brep=geo_5)  # -> Faces, Edges, Vertices
item_3 = ListItem(List=debrep_2.Faces, Index=0, Wrap=True)
area_4 = Area(Geometry=debrep_2.Faces)  # -> Area, Centroid
area_5 = Area(Geometry=item_3)  # -> Area, Centroid
ma_4 = MassAddition(Input=area_4.Area)  # -> Result, PartialResults
panel_12 = Panel(ma_4.Result)
panel_13 = Panel(area_5.Area)
subtraction = Subtraction(A=ma_4.Result, B=area_5.Area)
volume = Volume(Geometry=geo_5)  # -> Volume, Centroid
建筑体积 = Panel(volume.Volume)
建筑总表面积 = Panel(subtraction)
division = Division(A=建筑总表面积, B=建筑体积)

S = Script(base_face=item_3, north_line=line)  # -> out, angle_deg, orientation_text, best_vec, best_line
# ---------- S: Python ----------
"""
输入：
    base_face: Surface / Brep / BrepFace（建筑底面）
    north_line: Line（你画的北向线）

输出：
    angle_from_south: float，顺时针从正南偏移角度（-90~90）
    orientation_text: str（如南偏东 15°）
    best_vec: 向量（选中的参考边单位向量）
    best_line: 线段（建筑朝向参考边）
"""

import Rhino.Geometry as rg
import math

# ---------- Step 1：标准化输入 ----------
if isinstance(base_face, rg.Brep):
    face = base_face.Faces[0]
elif isinstance(base_face, rg.Surface):
    face = rg.Brep.CreateFromSurface(base_face).Faces[0]
elif isinstance(base_face, rg.BrepFace):
    face = base_face
else:
    raise Exception("输入必须为 Surface / Brep / BrepFace")

# ---------- Step 2：北向 → 正南向量 ----------
north_vec = north_line.Direction
north_vec = rg.Vector3d(north_vec.X, north_vec.Y, 0)
north_vec.Unitize()
south_vec = rg.Vector3d(-north_vec.X, -north_vec.Y, 0)
south_vec.Unitize()

# ---------- Step 3：提取所有边 ----------
face_brep = face.DuplicateFace(False)
edges = face_brep.DuplicateEdgeCurves()

best_line = None
best_vec = None
best_angle = 999
min_length_threshold = 2.0  # 忽略短边（单位：米，可调整）

for edge in edges:
    pt0 = edge.PointAtStart
    pt1 = edge.PointAtEnd
    vec = pt1 - pt0
    vec = rg.Vector3d(vec.X, vec.Y, 0)
    length = vec.Length
    if length < min_length_threshold:
        continue

    vec.Unitize()
    angle_rad = rg.Vector3d.VectorAngle(south_vec, vec)
    cross = rg.Vector3d.CrossProduct(south_vec, vec)
    if cross.Z < 0:
        angle_rad = -angle_rad
    angle_deg = math.degrees(angle_rad)

    if abs(angle_deg) < abs(best_angle):
        best_angle = angle_deg
        best_vec = vec
        best_line = rg.Line(pt0, pt1)

# ---------- Step 4：输出描述 ----------
angle_from_south = round(best_angle, 2)

if abs(angle_from_south) < 1e-3:
    orientation_text = "正南"
elif angle_from_south > 0:
    orientation_text = "南偏东 {:.1f}°".format(angle_from_south)
else:
    orientation_text = "南偏西 {:.1f}°".format(abs(angle_from_south))
# ---------- end S ----------
体型系数_2 = Panel(division)
S_2 = Script(value=体型系数_2)  # -> out, result
# ---------- S_2: Python ----------
"""
输入：
    value: 任意类型（string、float、int 都可能）
输出：
    result: float 类型值（或 None）
"""

try:
    result = float(value)
except:
    result = None  # 或者给默认值，比如 result = 0.0
# ---------- end S_2 ----------
建筑朝向 = Panel(S.orientation_text)
panel_14 = Panel(photovoltaicsperformancemetrics.embodiedEnergy)

# ---- group: 是否开始计算MRT
toggle_4 = BooleanToggle(True)

# ---- group: 是否开始计算Sky relation
toggle_5 = BooleanToggle(True)

# ---- group: 是否开始计算UTCI？
toggle_6 = BooleanToggle(True)

# ---- group: 夏季最热周UTCI
analysisperiod_4 = LBAnalysisPeriod(
    start_month=Slider(7, range=0..10),
    start_day=Slider(15, range=0..100),
    start_hour=Slider(8, range=0..10),
    end_month=Slider(7, range=0..10),
    end_day=Slider(22, range=0..100),
    end_hour=Slider(18, range=0..100))  # -> period, hoys, dates; plug-in component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

# ---- group: 冬季最冷周UTCI
analysisperiod_5 = LBAnalysisPeriod(
    start_month=Slider(1, range=0..10),
    start_day=Slider(15, range=0..100),
    start_hour=Slider(8, range=0..10),
    end_month=Slider(1, range=0..10),
    end_day=Slider(22, range=0..100),
    end_hour=Slider(18, range=0..100))  # -> period, hoys, dates; plug-in component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

# ----
importepw_3 = LBImportEPW(epw_file=open_weather_file)  # -> location, dry_bulb_temperature, dew_point_temperature, relative_humidity, wind_speed, wind_direction, direct_normal_rad, diffuse_horizontal_rad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; plug-in component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

genpts = LBGeneratePointGrid(geometry=geo_4, grid_size=Slider(10, range=0..10))  # -> flatten(points), vectors, face_areas, mesh; plug-in component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
humantosky = LBHumanToSkyRelation(
    location=importepw_3.location,
    position=flatten(genpts.points),
    context=flatten(geo_5),
    height=Slider(1.8, range=0..10),
    cpu_count=Slider(6, range=0..10),
    run=toggle_5)  # -> report, human_points, human_line, flatten(fract_body_exp), sky_exposure; plug-in component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

# ---- group: 夏季
applyper = LBApplyAnalysisPeriod(data=importepw_3.wind_speed, period=analysisperiod_4.period)  # -> data; plug-in component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
applyper_2 = LBApplyAnalysisPeriod(data=importepw_3.relative_humidity, period=analysisperiod_4.period)  # -> data; plug-in component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
applyper_3 = LBApplyAnalysisPeriod(data=humantosky.fract_body_exp, period=analysisperiod_4.period)  # -> data; plug-in component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
applyper_4 = LBApplyAnalysisPeriod(data=importepw_3.dry_bulb_temperature, period=analysisperiod_4.period)  # -> data; plug-in component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
applyper_5 = LBApplyAnalysisPeriod(data=importepw_3.direct_normal_rad, period=analysisperiod_4.period)  # -> data; plug-in component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
applyper_6 = LBApplyAnalysisPeriod(data=importepw_3.diffuse_horizontal_rad, period=analysisperiod_4.period)  # -> data; plug-in component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
applyper_7 = LBApplyAnalysisPeriod(data=importepw_3.horizontal_infrared_rad, period=analysisperiod_4.period)  # -> data; plug-in component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

# ---- group: 冬季
applyper_8 = LBApplyAnalysisPeriod(data=importepw_3.wind_speed, period=analysisperiod_5.period)  # -> data; plug-in component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
applyper_9 = LBApplyAnalysisPeriod(data=importepw_3.relative_humidity, period=analysisperiod_5.period)  # -> data; plug-in component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
applyper_10 = LBApplyAnalysisPeriod(data=importepw_3.horizontal_infrared_rad, period=analysisperiod_5.period)  # -> data; plug-in component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
applyper_11 = LBApplyAnalysisPeriod(data=humantosky.fract_body_exp, period=analysisperiod_5.period)  # -> data; plug-in component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
applyper_12 = LBApplyAnalysisPeriod(data=importepw_3.dry_bulb_temperature, period=analysisperiod_5.period)  # -> data; plug-in component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
applyper_13 = LBApplyAnalysisPeriod(data=importepw_3.diffuse_horizontal_rad, period=analysisperiod_5.period)  # -> data; plug-in component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
applyper_14 = LBApplyAnalysisPeriod(data=importepw_3.direct_normal_rad, period=analysisperiod_5.period)  # -> data; plug-in component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

# ----
outdoorsolarmrt = LBOutdoorSolarMRT(
    location=importepw_3.location,
    surface_temp=applyper_4,
    dir_norm_rad=applyper_5,
    diff_horiz_rad=applyper_6,
    horiz_infrared=applyper_7,
    fract_body_exp=applyper_3,
    sky_exposure=humantosky.sky_exposure,
    run=toggle_4)  # -> report, short_erf, long_erf, short_dmrt, long_dmrt, mrt; plug-in component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
utci = LBUTCIComfort(air_temp=applyper_4, mrt=outdoorsolarmrt.mrt, rel_humid=applyper_2, wind_vel=applyper, run=toggle_6)  # -> report, utci, comfort, condition, category, comf_obj; plug-in component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
xdata = LBDeconstructData(data=utci.utci)  # -> header, values; plug-in component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
avr_5 = Average(Input=xdata.values)  # -> flatten(ArithmeticMean)
colrange = LBColorRange(index=Slider(1, range=0..10))  # -> colors; plug-in component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
avr_6 = Average(Input=avr_5)
legendpar = LBLegendParameters(min="26", max="35", colors=colrange)  # -> leg_par; plug-in component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
heatmap = LBSpatialHeatmap(values=flatten(avr_5), mesh=genpts.mesh, legend_par=legendpar)  # -> mesh, legend, title, colors, legend_par, vis_set; plug-in component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
夏季最热周场地utci值 = Panel(avr_6)

outdoorsolarmrt_2 = LBOutdoorSolarMRT(
    location=importepw_3.location,
    surface_temp=applyper_12,
    dir_norm_rad=applyper_14,
    diff_horiz_rad=applyper_13,
    horiz_infrared=applyper_10,
    fract_body_exp=applyper_11,
    sky_exposure=humantosky.sky_exposure,
    run=toggle_4)  # -> report, short_erf, long_erf, short_dmrt, long_dmrt, mrt; plug-in component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
utci_2 = LBUTCIComfort(air_temp=applyper_12, mrt=outdoorsolarmrt_2.mrt, rel_humid=applyper_9, wind_vel=applyper_8, run=toggle_6)  # -> report, utci, comfort, condition, category, comf_obj; plug-in component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
xdata_2 = LBDeconstructData(data=utci_2.utci)  # -> header, values; plug-in component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
avr_7 = Average(Input=xdata_2.values)  # -> flatten(ArithmeticMean)
colrange_2 = LBColorRange(index=Slider(1, range=0..10))  # -> colors; plug-in component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
avr_8 = Average(Input=avr_7)
legendpar_2 = LBLegendParameters(min="-13", max="-8", colors=colrange_2)  # -> leg_par; plug-in component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
heatmap_2 = LBSpatialHeatmap(values=flatten(avr_7), mesh=genpts.mesh, legend_par=legendpar_2)  # -> mesh, legend, title, colors, legend_par, vis_set; disabled; plug-in component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
冬季最热周场地utci值 = Panel(avr_8)

# ---- group: 围护结构传热系数设定
S_3 = Script(year=建设年代, shape_coef=S_2.result)  # -> out, U_wall, U_ground, U_window, U_roof, SHGC_window
# ---------- S_3: Python ----------
"""
输入：
    year: int 或 str，建设年份
    shape_coef: float 或 str，体型系数
输出：
    U_roof: 屋面传热系数
    U_wall: 外墙传热系数
    U_ground: 地面传热系数
    U_window: 外窗传热系数
    SHGC_window: 外窗太阳得热系数
"""

def get_u_values(year, shape_coef):
    # ---- ✅ 类型转换 ----
    try:
        year = int(year)
    except:
        return None, None, None, None, None
    
    try:
        shape_coef = float(shape_coef)
    except:
        return None, None, None, None, None

    # ---- 判断规范年份 ----
    if year <= 1985:
        standard = "1985"
    elif year <= 2005:
        standard = "2006"
    elif year <= 2018:
        standard = "2019"
    else:
        standard = "2025"

    # ---- 判断体型系数 ----
    if shape_coef < 0.3:
        coef = "<0.3"
    elif shape_coef <= 0.5:
        coef = "0.3~0.5"
    else:
        coef = ">0.5"

    # ---- U值表 ----
    U_values = {
        "1985": {
            "0.3~0.5": [0.91, 1.28, 2.0, 6.4]
        },
        "2006": {
            "0.3~0.5": [0.45, 0.50, 1.5, 2.0]
        },
        "2019": {
            "<0.3":     [0.40, 0.50, 1.0, 1.8],
            "0.3~0.5":  [0.35, 0.45, 1.0, 1.6]
        },
        "2025": {
            "<0.3":     [0.15, 0.37, 1.0, 1.3],
            "0.3~0.5":  [0.15, 0.37, 1.0, 1.3]
        }
    }

    SHGC_values = {
        "1985": 0.60,
        "2006": 0.60,
        "2019": 0.40,
        "2025": {
            "<0.3": 0.35,
            "0.3~0.5": 0.45
        }
    }

    if standard in ["1985", "2006"]:
        coef_key = "0.3~0.5"
    else:
        coef_key = coef if coef in U_values[standard] else "0.3~0.5"

    U_roof, U_wall, U_ground, U_window = U_values[standard][coef_key]

    if isinstance(SHGC_values[standard], dict):
        SHGC_window = SHGC_values[standard].get(coef_key, 0.45)
    else:
        SHGC_window = SHGC_values[standard]

    return U_roof, U_wall, U_ground, U_window, SHGC_window

# 调用函数
U_roof, U_wall, U_ground, U_window, SHGC_window = get_u_values(year, shape_coef)
# ---------- end S_3 ----------
split = SplitList(List=["0.15", "0.53", "1.0", "1.4"], Index=Slider(0, range=0..1))  # -> ListA, ListB
division_2 = Division(A=Slider(1, range=0..1), B=split.ListA)
panel_15 = Panel(split.ListB)
windowmat = HBWindowMaterial(name="window", u_factor=S_3.U_window, shgc=S_3.SHGC_window)  # -> mat; plug-in component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
windowconstr = HBWindowConstruction(materials=windowmat)  # -> constr; plug-in component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
subfacesubset = HBSubfaceSubset(window=windowconstr)  # -> subface_set; plug-in component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

division_3 = Division(A="1", B=S_3.U_wall)

division_4 = Division(A="1", B=S_3.U_roof)

division_5 = Division(A="1", B=S_3.U_ground)

opaquematnomass = HBOpaqueMaterialNoMass(name="wall", r_value=division_3)  # -> mat; plug-in component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
opaquematnomass_2 = HBOpaqueMaterialNoMass(name="ground", r_value=division_5)  # -> mat; plug-in component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
opaquematnomass_3 = HBOpaqueMaterialNoMass(name="roof", r_value=division_4)  # -> mat; plug-in component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
opaqueconstr = HBOpaqueConstruction(materials=opaquematnomass_3)  # -> constr; plug-in component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
opaqueconstr_2 = HBOpaqueConstruction(materials=opaquematnomass)  # -> constr; plug-in component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
opaqueconstr_3 = HBOpaqueConstruction(materials=opaquematnomass_2)  # -> constr; plug-in component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
groundsubset = HBGroundConstructionSubset(ground_floor=opaqueconstr_3)  # -> ground_set; plug-in component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
exteriorsubset = HBExteriorConstructionSubset(exterior_wall=opaqueconstr_2, exterior_roof=opaqueconstr)  # -> exterior_set; plug-in component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
constructionset = HBConstructionSet(exterior_subset=exteriorsubset, ground_subset=groundsubset, subface_subset=subfacesubset)  # -> constr_set; plug-in component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

# ----
buildingsolid = DFBuildingFromSolid(bldg_geo=flatten(geo_5), floor_to_floor=建筑层高, program=programtype, constr_set=constructionset, run=Toggle(True))  # -> report, buildings; plug-in component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
applyfacadepar = DFApplyFacadeParameters(df_obj=buildingsolid.buildings, win_par=simpleratiopar)  # -> report, df_obj; plug-in component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
topbottom = DFSeparateTopBottom(buildings=flatten(applyfacadepar.df_obj))  # -> buildings; plug-in component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
decnstrdf = DFDeconstructObject(df_obj=topbottom)  # -> stories, room2ds; plug-in component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
panel_16 = Panel(S_3.U_roof)
panel_17 = Panel(S_3.U_ground)
panel_18 = Panel(S_3.U_wall)
panel_19 = Panel(S_3.SHGC_window)
panel_20 = Panel(S_3.U_window)
idealair = HBIdealAir(rooms=flatten(decnstrdf.room2ds))  # -> report, rooms; plug-in component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
rejoin = DFRejoinToBuilding(room2ds=flatten(idealair.rooms))  # -> buildings; plug-in component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
solveadj2d = DFSolveAdjacency(df_objs=rejoin, run=Toggle(True))  # -> report, df_objs; plug-in component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
model = DFModel(buildings=flatten(solveadj2d.df_objs))  # -> report, model; plug-in component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
tohoneybee = DFModelToHoneybee(model=model.model, run=Toggle(True))  # -> report, hb_models; plug-in component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
vizwiref = HBVisualizeWireframe(hb_objs=flatten(tohoneybee.hb_models))  # -> geo; plug-in component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
modeltoosm = HBModelToOSM(model=tohoneybee.hb_models, epw_file=open_weather_file, sim_par=simpar, write=toggle_3, run=toggle_3)  # -> report, jsons, osw, osm, idf, sql, zsz, rdd, html; plug-in component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
vizbytype = HBVisualizeByType(hb_objs=tohoneybee.hb_models)  # -> walls, interior_walls, roofs, ceilings, exterior_floors, interior_floors, air_walls, apertures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; plug-in component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

path_3 = Panel("C:\Users\Chevalier.Chen\Desktop\1.xlsx")  # disabled
number_slider_3 = Slider(1, range=1..10, expression="x*2")  # disabled
merge_2 = Merge(Data1=panel_3, Data2=panel_4, Data3=panel_5, Data4=panel_6, Data5=panel_8, Data6=panel_7)  # disabled
toggle_7 = BooleanToggle(False)  # disabled
toggle_8 = BooleanToggle(True)  # disabled
toggle_9 = BooleanToggle(False)  # disabled
panel_21 = Panel(merge_2)  # disabled
wo_2 = WriteOptions(
    FilePath=path_3,
    ClearDataOverwrite=toggle_7,
    SaveAfterWrite=toggle_8,
    CloseAfterWrite=toggle_9,
    ColumnStartPosition=1,
    RowStartPosition=number_slider_3)  # -> UserMessages, WriteOptions; disabled
path_4 = Panel("C:\Users\Chevalier.Chen\Desktop\11111.xlsx")  # disabled
panel_22 = Panel(wo_2.UserMessages)  # disabled
toggle_10 = BooleanToggle(False)  # disabled
toggle_11 = BooleanToggle(False)  # disabled
toggle_12 = BooleanToggle(False)  # disabled
readxl_2 = ReadExcelSheet(Run=toggle_12, FilePath=path_4, Worksheet="1", Listen=False)  # -> UserMessages, Columns, Rows; disabled
number_slider_4 = Slider(1, range=1..151)  # disabled
panel_23 = Panel(readxl_2.Columns)  # disabled
item_4 = ListItem(List=readxl_2.Columns, Index=number_slider_4, Wrap=True)  # disabled

fly = Ladybug_fly(inputSliders=number_slider_4, fly=toggle_2)  # -> Vviiiiiiiiiizzz; disabled; plug-in component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
panel_24 = Panel(item_4)  # disabled

merge_3 = Merge(
    Data1=flatten(panel_24),
    Data2=flatten(panel_16),
    Data3=flatten(panel_18),
    Data4=flatten(panel_17),
    Data5=flatten(panel_20),
    Data6=flatten(panel_19))  # -> graft(Result); disabled
panel_25 = Panel(merge_3)  # disabled
rec = DataRecorder(panel_25, DataLimit=6000, RecordData=True)  # disabled
panel_26 = Panel(rec)  # disabled
writexl = WriteToExcel(
    Run=toggle_11,
    ExcelWorksheet="1",
    ColumnNames=panel_21,
    WriteOptions=wo_2.WriteOptions,
    ColumnnsOrRows=toggle_10,
    DataToWriteIntoColumns=panel_26)  # disabled
panel_27 = Panel(writexl)  # disabled

eui = HBEndUseIntensity(sql=modeltoosm.sql)  # -> eui, eui_end_use, end_uses, gross_floor; plug-in component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
热源为燃煤锅炉的供暖系统综合效率 = Panel("0.94")
标准煤热值 = Panel("8.14")
综合发电煤耗 = Panel("0.33")
空调机组cop值 = Slider(3.2, range=0..10)
panel_28 = Panel(eui.eui_end_use)
multiplication_2 = Multiplication(A=热源为燃煤锅炉的供暖系统综合效率, B=标准煤热值, C=综合发电煤耗)

# ---- group: 制冷能耗
item_5 = ListItem(List=eui.eui_end_use, Index=Slider(1, range=0..100), Wrap=True)

# ---- group: 照明能耗
item_6 = ListItem(List=eui.eui_end_use, Index=Slider(2, range=0..100), Wrap=True)  # -> flatten(Item)

# ---- group: 采暖能耗
item_7 = ListItem(List=eui.eui_end_use, Index=Slider(0, range=0..100), Wrap=True)

# ----
panel_29 = Panel(item_5)
panel_30 = Panel(item_7)
division_6 = Division(A=panel_29, B=空调机组cop值)
division_7 = Division(A=panel_30, B=multiplication_2)

avr_9 = Average(Input=item_6)
制冷能耗 = Panel(division_6)
制热能耗 = Panel(division_7)
教学楼建筑面积 = Panel(eui.gross_floor)
addition_2 = Addition(A=教学楼建筑面积, B=其他体块总建筑面积)
division_8 = Division(A=addition_2, B=场地面积)
division_9 = Division(A=教学楼建筑面积, B=建筑层数)
容积率 = Panel(division_8)
建筑占地面积 = Panel(division_9)
照明能耗 = Panel(avr_9)
addition_3 = Addition(A=制热能耗, B=制冷能耗, C=照明能耗)
单位面积总能耗 = Panel(addition_3)
addition_4 = Addition(A=建筑占地面积, B=其他体块占地面积)
division_10 = Division(A=addition_4, B=场地面积)
建筑密度 = Panel(division_10)
merge_4 = Merge(
    Data1=flatten(教学楼建筑面积),
    Data2=flatten(建筑朝向),
    Data3=flatten(建筑占地面积),
    Data4=flatten(场地面积),
    Data5=flatten(建筑密度),
    Data6=flatten(容积率),
    Data7=flatten(体型系数_2),
    Data8=flatten(制冷能耗),
    Data9=flatten(制热能耗),
    Data10=flatten(照明能耗),
    Data11=flatten(单位面积总能耗))  # -> graft(Result)
panel_31 = Panel(merge_4)
rec_2 = DataRecorder(panel_31, DataLimit=6000, RecordData=True)
panel_32 = Panel(rec_2)
writexl_2 = WriteToExcel(
    Run=Toggle(False),
    ExcelWorksheet="1",
    ColumnNames=panel_10,
    WriteOptions=wo.WriteOptions,
    ColumnnsOrRows=Toggle(False),
    DataToWriteIntoColumns=panel_32)
panel_33 = Panel(writexl_2)

# ==== cluster Cluster
